test file "DoorLockCntr_Test"
  coverage: Decision, MCDC, Condition, SaturationOnIntOverflow

suite "DoorLockCommand"

  case "DLock_Unlock" [baseline]
    model DoorLockCntr, harness DoorLockCntr_Harness, mode Normal
    input "NORMAL1" from Testcase_DoorLockCntr_lockunlock.xlsx, mapped to AirBagOn, EngStart, Speed, LeftDPos, RightDPos (active)
    input "NORMAL2" from Testcase_DoorLockCntr_lockunlock.xlsx, mapped to AirBagOn, EngStart, Speed, LeftDPos, RightDPos
    baseline "NORMAL1"
      DLockCmd
      DLockDiag
    baseline "NORMAL2"
      DLockCmd
      DLockDiag
    iterations:
      Iteration1: ExternalInput "NORMAL1", Baseline "NORMAL1"
      Iteration2: ExternalInput "NORMAL2", Baseline "NORMAL2"

suite "DoorLockDiag"

  case "DLock_Diag" [baseline]
    model DoorLockCntr, harness DoorLockCntr_Harness, mode Normal
    input "DIAG" from Testcase_DoorLockCntr_diag.xlsx, mapped to AirBagOn, EngStart, Speed, LeftDPos, RightDPos (active)
    baseline "DIAG"
      DLockCmd
      DLockDiag